# Grasshopper definition kluster.gh (Grasshopper 1.0.7)

A = A()
B = B()
yz = YZPlane(Origin=Point(0, 0, 0))
N = Step()
S = Start()
X = XSize()
Y = YSize()
division = Division(A=A, B=B)
series = Series(Start=S, Step=N, Count=division)
planesrf = PlaneSurface(Plane=yz, XSize=X, YSize=Y)
lng = ListLength(List=series)
X_2 = UnitX(Factor=series)
L = Length(lng)
move = Move(Geometry=planesrf, Motion=X_2)  # -> Geometry, Transform
merge = Merge(Data1=planesrf, Data2=move.Geometry)
A_2 = BrepA()
bbx = BrepBrep(BrepA=A_2, BrepB=merge)  # -> Curves, Points
N_2 = Count()
divide = DivideCurve(Curve=bbx.Curves, Count=N_2, Kinks=False)  # -> Points, Tangents, Parameters
P = Points(divide.Points)
