# Grasshopper definition pias export.gh (Grasshopper 1.0.7)

# geef aan hoe veel punten je wil hebben en de tussen afstand van de ordinaten
# --->
ordinaat_afstant = Slider(5, range=0..100)
holte = Slider(23, range=0..100)
# geef je schip parameters in in M
# --->
_1_2_brete = Slider(17, range=0..100)
# NOTE
# 
# dit bestand is gemaakt om met een python script samen tewerken
# 
# het schip moet in meters staan anders geeft het de verkeerde warde aan
# vul je ronp vorm hier aan toe
# --->
l_ship = Slider(168, range=0..1000)
resulutie = Slider(27, range=0..100)
brep = Brep(<brep referenced from the Rhino model>)
panel = Panel("""aantal spanten
--->""")
cluster = Cluster(A_2=brep, N_2=resulutie, X=_1_2_brete, Y=holte, S=ordinaat_afstant, N=ordinaat_afstant, A=l_ship, B=ordinaat_afstant)  # -> P, L
panel_2 = Panel(cluster.L)
# als alles klaar is klik rechter muisknop op het paneel en kies de optie "stream destination"
# dit document is nodig in het python script
# --->
panel_3 = Panel(cluster.P)

# ==== cluster Cluster
S = ClusterInput()
N = ClusterInput()
A = ClusterInput()
B = ClusterInput()
X = ClusterInput()
Y = ClusterInput()
A_2 = ClusterInput()
N_2 = ClusterInput()
yz = YZPlane(Origin=Point(0, 0, 0))
division = Division(A=A, B=B)
series = Series(Start=S, Step=N, Count=division)
planesrf = PlaneSurface(Plane=yz, XSize=X, YSize=Y)
lng = ListLength(List=series)
L = ClusterOutput(lng)
X_2 = UnitX(Factor=series)
move = Move(Geometry=planesrf, Motion=X_2)  # -> Geometry, Transform
merge = Merge(Data1=planesrf, Data2=move.Geometry)
bbx = BrepBrep(BrepA=A_2, BrepB=merge)  # -> Curves, Points
divide = DivideCurve(Curve=bbx.Curves, Count=N_2, Kinks=False)  # -> Points, Tangents, Parameters
P = ClusterOutput(divide.Points)
