# Grasshopper definition pias export.gh (Grasshopper 1.0.7)

yz = YZPlane(Origin=Point(0, 0, 0))
number_slider = Slider(4, range=0..100)
planesrf = PlaneSurface(Plane=yz, XSize=Slider(15, range=0..100), YSize=Slider(24, range=0..100))
division = Division(A=Slider(168, range=0..1000), B=number_slider)
series = Series(Start=number_slider, Step=number_slider, Count=division)
X = UnitX(Factor=series)
lng = ListLength(List=series)
panel = Panel(lng)
move = Move(Geometry=planesrf, Motion=X)  # -> Geometry, Transform
brep = Brep(<brep referenced from the Rhino model>)
bbx = BrepBrep(BrepA=brep, BrepB=move.Geometry)  # -> Curves, Points
divide = DivideCurve(Curve=bbx.Curves, Count=Slider(30, range=0..100), Kinks=False)  # -> Points, Tangents, Parameters
panel_2 = Panel(divide.Points)
